# Grasshopper definition MPDA22-session03_hops.gh (Grasshopper 1.0.7)
# plug-ins: Kangaroo2 Components, Hops, MeshEdit Components, Kangaroo Components

subd = SubD(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)
meshsubd = MeshFromSubD(SubD=subd, Density=Slider(0, range=0..2))
triremesh = TriRemesh(Geometry=meshsubd, Length=Slider(2, range=1..2), Iterations=25)  # -> Triangulation, Dual, Creases
data = Data(triremesh.Triangulation)
data_2 = Data(meshsubd)
clean = CombineClean(Meshes=data_2)
explodemesh = GhPythonScript(m=clean)  # -> out, a; inputs m: Mesh
# ---------- explodemesh: Python ----------
import Rhino.Geometry as rg

ghenv.Component.Message = "explode mesh"

exploded = []

for i in range(m.Faces.Count):
    m_copy = m.Duplicate()
    face = m_copy.Faces.ExtractFaces([i])
    exploded.append(face)
    
a = exploded
# ---------- end explodemesh ----------
toggle = BooleanToggle(True)
concat = Concatenate(FragmentA="http://127.0.0.1:5000", FragmentB="/shortestpath")
explode = MeshExplode(Mesh=data, Interpolate=False)
hops = Hops(
    _Path=concat,
    InputMesh=data,
    FaceIndex1=Slider(44, range=0..100),
    FaceIndex2=Slider(127, range=0..431),
    CacheResultsInMemory=True,
    CacheSolveResults=True,
    RemoteDefinitionLocation="http://127.0.0.1:5000/shortestpath",
    RemoteSolveVersion=(0, 1, 0),
    ShowInput_Enabled=False,
    ShowInput_Path=True,
    SynchronousSolve=True)
item = ListItem(List=explode, Index=hops, Wrap=True)
clean_2 = CombineClean(Meshes=item)
preview = CustomPreview(Geometry=explode, Material=ColourSwatch(SwatchColor=RGBA(120, 246, 255, 78)))
preview_2 = CustomPreview(Geometry=clean_2, Material=ColourSwatch(SwatchColor=RGB(255, 0, 0)))
